# Grasshopper definition 1_oscillator.gh (Grasshopper 1.0.7)
# plug-ins: Siren

crv = Curve([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])
nickname = CVFromGeometryComponent(Curve=crv, SampleRate="200")  # -> Wave, Trigger
number_slider = Slider(0.1, range=0..0.1)
nickname_2 = CVQuantizer(Wave=nickname.Wave, scaleName="Major Pentatonic")  # -> Wave, Trigger
nickname_3 = CVOscillatorComponent(Frequency=nickname_2.Wave, Tuning=number_slider, wavetype="Square")
nickname_4 = CVOscillatorComponent(Frequency=nickname_2.Wave, wavetype="Sawtooth")
nickname_5 = CVOscillatorComponent(Frequency=nickname_2.Wave, Octave=Slider(-1, range=-1..2), Tuning=number_slider, wavetype="Square")
mixer = Mixer(W1=nickname_4, W2=nickname_3, Wave3=nickname_5)
crv_2 = Curve([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])
nickname_6 = CVFromGeometryComponent(Curve=crv_2, SampleRate="200")  # -> Wave, Trigger
nickname_7 = VCAComponent(Wave=mixer, Amplitude=nickname_6.Wave)
nickname_8 = AudioOutComponent(Wave=nickname_7)  # -> PlayProgress, Level
nickname_9 = SampleToCurveComponent(Wave=nickname_7, Resolution="1000", PlayProgress=nickname_8.PlayProgress)  # -> Polyline, Playhead
