# Grasshopper definition 2_drumMachine.gh (Grasshopper 1.0.7)
# plug-ins: Siren

number_slider = Slider(10, range=10..100)
number_slider_2 = Slider(120, range=0..1000)
number_slider_3 = Slider(3, range=0..10)
number_slider_4 = Slider(0, range=0..1)
xy = XYPlane(Origin=Point(0, 0, 0))
crv = Curve(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)
python = GhPythonScript(tempo=number_slider_2, division="3/16", T=number_slider, duration=number_slider_3, offset=number_slider_4)  # -> beats
# ---------- python: Python ----------
__author__ = "alasd"
__version__ = "2021.10.02"

from Rhino import Geometry as g

div_length = (tempo/60) * division * T

beats = [g.Point3d(offset*div_length, 0,0)]
if div_length > 0:
    elapsedTime = offset*div_length
    while elapsedTime < duration * T:
        elapsedTime += div_length
        point = g.Point3d(elapsedTime, 0,0)
        beats.append(point)
# ---------- end python ----------
python_2 = GhPythonScript(tempo=number_slider_2, division="1/2", T=number_slider, duration=number_slider_3, offset=Slider(0, range=0..1))  # -> beats; same code as python
python_3 = GhPythonScript(tempo=number_slider_2, division="1/4", T=number_slider, duration=number_slider_3, offset=number_slider_4)  # -> beats; same code as python
python_4 = GhPythonScript(tempo=number_slider_2, division="1/2", T=number_slider, duration=number_slider_3, offset=Slider(0.5, range=0..1))  # -> beats; same code as python
nickname = CVComponent(
    Curve=crv,
    Plane=xy,
    TimeFactor=number_slider,
    AmplitudeFactor=Slider(10, range=0..10),
    SampleRate=Slider(100, range=0..100))  # -> Wave, Trigger
number_slider_5 = Slider(10, range=0..10)
nickname_2 = NoiseComponent(Duration=Slider(1, range=0..1), wavetype="White")
merge = Merge(Data1=python_3, Data2=python)
crv_2 = Curve(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)
nickname_3 = VCAComponent(Wave=nickname_2, Amplitude=nickname.Wave)
nickname_4 = CVComponent(Curve=crv_2, TimeFactor=number_slider_5, AmplitudeFactor=number_slider_5, SampleRate=Slider(9, range=0..100))  # -> Wave, Trigger
path = FilePath("C:\Users\alasd\Downloads\musicradar-essential-drumkit-samples\Chip Tune Kit\ChipTune Closed Hat 01.wav")
path_2 = FilePath("C:\Users\alasd\Downloads\musicradar-essential-drumkit-samples\Chip Tune Kit\ChipTune Kick 01.wav")
nickname_5 = CVQuantizer(Wave=nickname_4.Wave, scaleName="Major Pentatonic")
path_3 = FilePath("C:\Users\alasd\Downloads\musicradar-essential-drumkit-samples\Chip Tune Kit\ChipTune Snare 01.wav")
nickname_6 = ReadSampleComponent(Path=path)
nickname_7 = ReadSampleComponent(Path=path_3)
nickname_8 = ReadSampleComponent(Path=path_2)
osc = CVOscillator(Frequency=nickname_5, Tuning=Slider(7, range=0..10), wavetype="Triangle")
osc_2 = CVOscillator(Frequency=nickname_5, wavetype="Triangle")
nickname_9 = PulseFromPointsComponent(Point=python_2)
nickname_10 = PulseFromPointsComponent(Point=python_4)
nickname_11 = PulseFromPointsComponent(Point=merge)
nickname_12 = MixerComponent(Wave=[osc_2, osc, nickname_3])
nickname_13 = SamplePlayerComponent(Sample=nickname_6, Points=nickname_11)
nickname_14 = SamplePlayerComponent(Sample=nickname_7, Points=nickname_10)
nickname_15 = SamplePlayerComponent(Sample=nickname_8, Points=nickname_9)
nickname_16 = AttenuverterComponent(Wave=nickname_12, Attenuation=Slider(1, range=0..10))
nickname_17 = MixerComponent(Wave=[nickname_15, nickname_14, nickname_13])  # -> flatten(Wave)
nickname_18 = SampleToCurveComponent(Wave=nickname_17, Resolution=Slider(275, range=0..1000))
nickname_19 = MixerComponent(Wave=[nickname_16, nickname_17])
nickname_20 = AudioOutComponent(Wave=nickname_17)
aout = AudioOut(Wave=nickname_19)
wavestreamparameter = WaveStreamParameter(nickname_19)
